# Grasshopper definition tess.gh (Grasshopper 1.0.7)
# plug-ins: ghgl

B = Boundary({Plane=PlaneXY(0, 0, 0), Size=Domain2(u=-10..10, v=-10..10)})
mplane = MeshPlane(Boundary=B, WidthCount=10, HeightCount=10)  # -> Mesh, Area
demesh = DeconstructMesh(Mesh=mplane.Mesh)  # -> Vertices, Faces, Colours, Normals
drec = DeconstuctRectangle(Rectangle=B)  # -> BasePlane, XInterval, YInterval
faceb = FaceBoundaries(Mesh=mplane.Mesh)
gl_shader = GLShader(
    DepthTestingEnabled=True,
    DepthWritingEnabled=True,
    DrawMode=0,
    FragmentShader="""#version 330

in vec4 vertex_color;
out vec4 fragment_color;

void main() {
  fragment_color = vertex_color;
}""",
    GLShader=(0, 2, 0),
    PreviewSortOrder=5,
    VertexShader="""#version 330

layout(location = 0) in vec3 vertex;
layout(location = 1) in vec4 vcolor;

uniform mat4 _worldToClip;
out vec4 vertex_color;

void main() {
  vertex_color = vcolor;
  gl_Position = _worldToClip * vec4(vertex, 1.0);
}""",
    glLineWidth=3,
    glPointSize=8)  # -> Color, Depth; disabled
gl_mesh = GLMeshShader(
    DepthTestingEnabled=True,
    DepthWritingEnabled=True,
    DrawMode=4,
    FragmentShader="""#version 410 core

uniform vec3 _lightDirection[4];
uniform mat3 _worldToCameraNormal;

out vec4 fragment_color;

void main(void)
{
	fragment_color = vec4(1.0,1.0,1.0,1.0);
}""",
    GLShader=(0, 2, 0),
    GeometryShader="""#version 410 core

layout(triangles, invocations = 1) in;
layout(line_strip, max_vertices = 4) out;

void main(void)
{
	gl_Position = gl_in[0].gl_Position;
	EmitVertex();	
	gl_Position = gl_in[1].gl_Position;
	EmitVertex();
	gl_Position = gl_in[2].gl_Position;
	EmitVertex();
	gl_Position = gl_in[3].gl_Position;
	EmitVertex();
	
	EndPrimitive();
}""",
    PreviewSortOrder=5,
    TessCtrlShader="""#version 410 core

layout(vertices = 4) out;

void main(void)
{
     gl_TessLevelOuter[0] = 2.0;
     gl_TessLevelOuter[1] = 4.0;
     gl_TessLevelOuter[2] = 6.0;
     gl_TessLevelOuter[3] = 8.0;

     gl_TessLevelInner[0] = 8.0;
     gl_TessLevelInner[1] = 8.0;

     gl_out[gl_InvocationID].gl_Position = gl_in[gl_InvocationID].gl_Position;
}""",
    TessEvalShader="""#version 410 core

layout(quads, equal_spacing, ccw) in;

//quad interpol
vec4 interpolate(in vec4 v0, in vec4 v1, in vec4 v2, in vec4 v3)
{
    vec4 a = mix(v0, v1, gl_TessCoord.x);
    vec4 b = mix(v3, v2, gl_TessCoord.x);
    return mix(a, b, gl_TessCoord.y);
}

void main()
{ 
    gl_Position = interpolate(
        gl_in[0].gl_Position, 
        gl_in[1].gl_Position, 
        gl_in[2].gl_Position, 
        gl_in[3].gl_Position
    );
}""",
    VertexShader="""#version 410 core

layout(location = 0) in vec3 _meshVertex;
layout(location = 1) in vec3 _meshNormal;
layout(location = 3) in vec4 _meshVertexColor;

uniform mat4 _worldToClip;

out vec4 color_vs;

void main(void)
{
	color_vs.xyz =  _meshVertexColor.xyz; //mix( vec4(1,1,0,0),vec4(0,1,1,0),  vertex.w);
	gl_Position = _worldToClip * vec4(_meshVertex, 1.0);
}""",
    glLineWidth=3,
    glPointSize=8)  # -> Color, Depth; disabled
num = Number(drec.YInterval)
num_2 = Number(drec.XInterval)
pt = Point(drec.BasePlane)
gl_shader_2 = GLShader(
    Vertex=demesh.Vertices,
    Vcolor=ColourSwatch(SwatchColor=RGB(163, 57, 57)),
    DepthTestingEnabled=True,
    DepthWritingEnabled=True,
    DrawMode=14,
    FragmentShader="""#version 410 core

out vec4 fragment_color;

void main(void)
{
	fragment_color = vec4(1.0,1.0,1.0,1.0);
}""",
    GLShader=(0, 2, 0),
    GeometryShader="""#version 410 core

layout(triangles, invocations = 1) in;
layout(line_strip, max_vertices = 4) out;

void main(void)
{
	gl_Position = gl_in[0].gl_Position;
	EmitVertex();	
	gl_Position = gl_in[1].gl_Position;
	EmitVertex();
	gl_Position = gl_in[2].gl_Position;
	EmitVertex();
	gl_Position = gl_in[3].gl_Position;
	EmitVertex();
	
	EndPrimitive();
}""",
    PreviewSortOrder=4,
    TessCtrlShader="""#version 410 core

layout(vertices = 4) out;

void main(void)
{
     gl_TessLevelOuter[0] = 2.0;
     gl_TessLevelOuter[1] = 4.0;
     gl_TessLevelOuter[2] = 6.0;
     gl_TessLevelOuter[3] = 8.0;

     gl_TessLevelInner[0] = 8.0;
     gl_TessLevelInner[1] = 8.0;

     gl_out[gl_InvocationID].gl_Position = gl_in[gl_InvocationID].gl_Position;
}""",
    TessEvalShader="""#version 410 core

layout(quads, equal_spacing, ccw) in;

//quad interpol
vec4 interpolate(in vec4 v0, in vec4 v1, in vec4 v2, in vec4 v3)
{
    vec4 a = mix(v0, v1, gl_TessCoord.x);
    vec4 b = mix(v3, v2, gl_TessCoord.x);
    return mix(a, b, gl_TessCoord.y);
}

void main()
{ 
    gl_Position = interpolate(
        gl_in[0].gl_Position, 
        gl_in[1].gl_Position, 
        gl_in[2].gl_Position, 
        gl_in[3].gl_Position
    );
}""",
    VertexShader="""#version 410 core

layout(location = 0) in vec3 vertex;
layout(location = 1) in vec4 vcolor;

uniform mat4 _worldToClip;

out vec4 color_vs;

void main(void)
{
	color_vs.xyz =  vcolor.xyz; //mix( vec4(1,1,0,0),vec4(0,1,1,0),  vertex.w);
	gl_Position = _worldToClip*vec4(vertex, 1.0);
}""",
    glLineWidth=3,
    glPointSize=8)  # -> Color, Depth
gl_mesh_2 = GLMeshShader(
    DepthTestingEnabled=True,
    DepthWritingEnabled=True,
    DrawMode=4,
    FragmentShader="""#version 330

uniform vec3 _lightDirection[4];
uniform mat3 _worldToCameraNormal;

in  vec3 normal;
out vec4 fragment_color;

void main() {
  vec3 l = normalize(_lightDirection[0]);
  vec3 camNormal = _worldToCameraNormal * normal;
  float intensity = dot(l, normalize(camNormal.xyz));
  vec4 diffuse = vec4(1.0, 0.0, 1.0, 1.0);

  vec3 ambient = vec3(0.1, 0.1, 0.1) * diffuse.rgb;
  vec3 c = ambient + diffuse.rgb * abs(intensity);
  fragment_color = vec4(c, diffuse.a);
}""",
    GLShader=(0, 2, 0),
    PreviewSortOrder=5,
    VertexShader="""#version 330

layout(location = 0) in vec3 _meshVertex;
layout(location = 1) in vec3 _meshNormal;

uniform mat4 _worldToClip;
out vec3 normal;

void main() {
  normal = _meshNormal;
  gl_Position = _worldToClip * vec4(_meshVertex , 1.0);
}""",
    glLineWidth=3,
    glPointSize=8)  # -> Color, Depth; disabled
