# Grasshopper definition mesh_lit.gh (Grasshopper 1.0.7)
# plug-ins: ghgl

colour = ColourPicker(PickedColour=RGB(56, 167, 214))
brep = Brep([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])
col = Colour(colour)
gl_mesh = GLMeshShader(
    M=brep,
    MaterialColor=col,
    DepthTestingEnabled=True,
    DepthWritingEnabled=True,
    DrawMode=4,
    FragmentShader="""#version 330

uniform int _lightCount;
uniform vec3 _lightDirection[4];
uniform vec4 materialColor;
uniform mat3 _worldToCameraNormal;

in vec3 normal;
void main()
{
  vec3 l = normalize(_lightDirection[0]);
  vec3 camNormal = _worldToCameraNormal * normal;
  float intensity = abs(dot(l,normalize(camNormal.xyz)));

  vec3 ambient = vec3(0.1,0.1,0.1) * materialColor.rgb;
  vec3 c = ambient + materialColor.rgb * intensity;
  gl_FragColor = vec4(c, materialColor.a);
}""",
    GLShader=(0, 2, 0),
    PatchVertices=0,
    PreviewSortOrder=5,
    VertexShader="""#version 330

layout(location = 0) in vec3 _meshVertex;
layout(location = 1) in vec3 _meshNormal;

uniform mat4 _worldToClip;
out vec3 normal;

void main() 
{
  normal = _meshNormal;
  gl_Position = _worldToClip * vec4(_meshVertex,1);
}""",
    glLineWidth=3,
    glPointSize=8)  # -> Color, Depth
